# Grasshopper definition 09RotatedIterativeBox.gh (Grasshopper 1.0.7)
# plug-ins: ScriptParasite

pt = Point(Point(3816.769649, -1507, 637.0967114))
B = Base(PlaneXY(0, 0, 0))
data = Data(Slider(1200, range=0..10000))
data_2 = Data(Slider(61, range=0..100))
data_3 = Data(Slider(29, range=0..360))
data_4 = Data(Slider(34, range=0..100))
data_5 = Data(pt)
data_6 = Data(Slider(1200, range=0..10000))
data_7 = Data(Slider(37, range=0..100))
data_8 = Data(Slider(3, range=0..360))
data_9 = Data(Slider(14, range=0..100))
xy = XYPlane(Origin=Point(0, 0, 0))
yz = YZPlane(Origin=Point(0, 0, 0))
xz = XZPlane(Origin=Point(0, 0, 0))

c_script = CSharpScript(centerPt=data_5, length=data_6, radiusOfPipe=data_7, angle=data_8, count=data_9)  # -> out, outFrames; inputs centerPt: Point3d, length: Double, radiusOfPipe: Double, angle: Double, count: Int32
# ---------- c_script: C# usings ----------
using Grasshopper.Kernel.Types.Transforms;
# ---------- c_script: C# ----------
    angle = RhinoMath.ToRadians(angle);

    Plane basePlane = new Plane(centerPt, Vector3d.ZAxis);
    Interval intervalLength = new Interval(-length / 2, length / 2);
    Box originBox = new Box(basePlane, intervalLength, intervalLength, intervalLength);
    Curve[] wireframes=originBox.ToBrep().GetWireframe(-1);

    if(radiusOfPipe<=0)
    {
      Print("Invalid radius value");
      return;
    }

    List<Brep> pipeList = new List<Brep>();
    for (int i = 0; i < wireframes.Length; i++)
    {
      Brep[] pipe =Brep.CreatePipe(wireframes[i], radiusOfPipe, true, PipeCapMode.Round, true, 0.1, 0.1);
      pipeList.AddRange(pipe);
    }
    GH_Brep pipeFrame = new GH_Brep(Brep.CreateBooleanUnion(pipeList, 0.1)[0]);

    ITransform transform1 = new Rotation(centerPt, Vector3d.XAxis, angle);
    ITransform transform2 = new Rotation(centerPt, -1*Vector3d.YAxis, angle);
    ITransform transform3 = new Rotation(centerPt, Vector3d.ZAxis, angle);
    List<GH_Transform> resourceForms = new List<GH_Transform>();
    resourceForms.Add(new GH_Transform(transform1));
    resourceForms.Add(new GH_Transform(transform2));
    resourceForms.Add(new GH_Transform(transform3));

    GH_Transform compoundTransform = new GH_Transform();
    foreach (GH_Transform resourceForm in resourceForms)
    {
      foreach (ITransform transform in resourceForm.CompoundTransforms)
      {
        compoundTransform.CompoundTransforms.Add(transform.Duplicate());
      }
    }
    compoundTransform.ClearCaches();

    GH_Brep gh_Brep = new GH_Brep(originBox.ToBrep());
    gh_Brep.Transform(compoundTransform.Value);
    Transform xformForBoundingBox = Transform.ChangeBasis(Plane.WorldXY, Plane.WorldXY);
    GH_Box innerGhBox = new GH_Box(originBox);
    GH_Box outterGhBox = new GH_Box(GH_Brep.BrepTightBoundingBox(gh_Brep.Value));
    double scaleFactor = Math.Abs((innerGhBox.Value.X.Max-innerGhBox.Value.X.Min) / (outterGhBox.Value.X.Max-outterGhBox.Value.X.Min));

    ITransform transform4 = new Scale(centerPt, scaleFactor);
    compoundTransform.CompoundTransforms.Add(transform4.Duplicate());
    compoundTransform.ClearCaches();

    List<GH_Transform> list = new List<GH_Transform>();
    list.Add(compoundTransform);
    List<int> repeatCounts = new List<int>();
    for (int i = 0; i < count; i++)
    {
      repeatCounts.Add(i+1);
    }
    DataTree<GH_Transform> compoundTransformTree = new DataTree<GH_Transform>();
    int num2 = -1;
    for (int i = 0; i < repeatCounts.Count; i++)
    {
      for (int j = 0; j < repeatCounts[i]; j++)
      {
        num2++;
        if (num2 == list.Count)
        {
          num2 = 0;
        }
        compoundTransformTree.Add(list[num2],new GH_Path(i));
      }
    }

    List<GH_Transform> resultCompoundTransformList = new List<GH_Transform>();
    for (int i = 0; i < compoundTransformTree.BranchCount; i++)
    {
      GH_Transform resultCompoundTransform = new GH_Transform();
      foreach(GH_Transform gh_trans in compoundTransformTree.Branch(i))
      {
        foreach(ITransform itrans in gh_trans.CompoundTransforms)
        {
          resultCompoundTransform.CompoundTransforms.Add(itrans);
        }
      }
      resultCompoundTransform.ClearCaches();
      resultCompoundTransformList.Add(resultCompoundTransform);
    }

    List<GH_Brep> resultBrepFrames = new List<GH_Brep>();
    resultBrepFrames.Add(pipeFrame);
    for (int i = 0; i < resultCompoundTransformList.Count; i++)
    {
      GH_Brep resultBrepFrame = pipeFrame.DuplicateBrep();
      resultBrepFrame.Transform(resultCompoundTransformList[i].Value);
      resultBrepFrames.Add(resultBrepFrame);
    }


    outFrames = resultBrepFrames;
# ---------- end c_script ----------
scriptpar = ScriptParasite(Enable=Toggle(True), Folder="D:\软件\Rhino相关\KevinShopTest\09RotatedIterativeBox")

merge = Merge(Data1=xy, Data2=yz, Data3=xz)
box = CenterBox(Base=B, X=data, Y=data, Z=data)
rotate = Rotate(Angle=degrees(data_3), Plane=merge)  # -> Geometry, Transform
comp = Compound(Transforms=rotate.Transform)
transform = Transform(Geometry=box, Transform=comp)
bbox = BoundingBox(Content=transform, Plane=PlaneXY(0, 0, 0))  # -> Box, Box_2
debox = DeconstructBox(Box=box)  # -> Plane, X, Y, Z
debox_2 = DeconstructBox(Box=bbox.Box)  # -> Plane, X, Y, Z
dedomain = DeconstructDomain(Domain=debox.X)  # -> Start, End
dedomain_2 = DeconstructDomain(Domain=debox_2.X)  # -> Start, End
wires = BrepWireframe(Brep=box, Density=-1)
division = Division(A=dedomain.Start, B=dedomain_2.Start)
pipe = Pipe(Curve=wires, Radius=data_2, Caps=2)  # -> flatten(Pipe)
scale = Scale(Center=Point(0, 0, 0), Factor=division)  # -> Geometry, Transform
merge_2 = Merge(Data1=comp, Data2=scale.Transform)  # -> flatten(Result)
group = Group(Objects=pipe)
series = Series(Start=0, Step=1, Count=data_4)
comp_2 = Compound(Transforms=merge_2)
repeat = RepeatData(Data=comp_2, Length=series)  # -> simplify(Data)
comp_3 = Compound(Transforms=repeat)  # -> flatten(Compound)
transform_2 = Transform(Geometry=group, Transform=comp_3)
panel = Panel(repeat)
panel_2 = Panel(comp_3)
