# Grasshopper definition SpliceStructrue.gh (Grasshopper 1.0.7)

高出最低处的高度 = Slider(154, range=0..1000)
下端距离 = Slider(50, range=0..100)
厚度 = Slider(20, range=0..1000)
间距 = Slider(302, range=0..1000)
X = UnitX(Factor=1)
srf = Surface(<surface referenced from the Rhino model>)
data = Data(srf)
data_2 = Data(X)
data_3 = Data(高出最低处的高度)
data_4 = Data(下端距离)
data_5 = Data(间距)
data_6 = Data(厚度)
Z = UnitZ(Factor=1)
O = Origin(Point(0, 0, 0))
xprod = CrossProduct(VectorA=data_2, VectorB=Z, Unitize=True)  # -> Vector, Length
pl = ConstructPlane(Origin=O, XAxis=data_2, YAxis=xprod.Vector)
bbox = BoundingBox(Content=data, Plane=pl)  # -> Box, Box_2
contour = Contour(Shape=data, Point=O, Direction=data_2, Distance=data_5)  # -> simplify(flatten(Contours))
contour_2 = Contour(Shape=data, Point=O, Direction=xprod.Vector, Distance=data_5)  # -> simplify(flatten(Contours))
debox = DeconstructBox(Box=bbox.Box)  # -> Plane, X, Y, Z
entwine = Entwine(Branch00=contour, Branch01=contour_2, FlattenInputs=True)  # -> simplify(graft(Result))
volume = Volume(Geometry=bbox.Box)  # -> Volume, Centroid
ccx = CurveCurve(CurveA=graft(contour), CurveB=contour_2)  # -> simplify(Points), ParamsA, ParamsB
dedomain = DeconstructDomain(Domain=debox.Z)  # -> Start, End
subtraction = Subtraction(A=dedomain.Start, B=dedomain.End)
division = Division(A=data_6, B="2")
abs = Absolute(Value=subtraction)
division_2 = Division(A=abs, B=2)
neg = Negative(Value=division)
Z_2 = UnitZ(Factor=division_2)
Z_3 = UnitZ(Factor=data_3)
rev = Reverse(Vector=Z_2)
dom = ConstructDomain(DomainStart=neg, DomainEnd=division)
Z_4 = UnitZ(Factor=data_3)
move = Move(Geometry=volume.Centroid, Motion=Z_2)  # -> Geometry, Transform
move_2 = Move(Geometry=volume.Centroid, Motion=rev)  # -> Geometry, Transform
rev_2 = Reverse(Vector=Z_3)
move_3 = Move(Geometry=move.Geometry, Motion=Z_4)  # -> Geometry, Transform
move_4 = Move(Geometry=move_2.Geometry, Motion=rev_2)  # -> Geometry, Transform
xy = XYPlane(Origin=move_3.Geometry)
xy_2 = XYPlane(Origin=move_4.Geometry)
project = Project(Geometry=entwine, Plane=xy)  # -> Geometry, Transform
Z_5 = UnitZ(Factor=1)
merge = Merge(Data1=entwine, Data2=project.Geometry)
project_2 = Project(Geometry=ccx.Points, Plane=xy)  # -> Geometry, Transform
ln = Line(StartPoint=ccx.Points, EndPoint=project_2.Geometry)
len = Length(Curve=ln)
subtraction_2 = Subtraction(A=len, B=data_4)
amp = Amplitude(Vector=Z_5, Amplitude=subtraction_2)
end = EndPoints(Curve=merge)  # -> Start, End
pl_2 = ConstructPlane(Origin=project_2.Geometry, XAxis=data_2, YAxis=xprod.Vector)
rev_3 = Reverse(Vector=amp)
rectangle = Rectangle(Plane=pl_2, XSize=dom, YSize=dom, Radius=0)  # -> Rectangle, Length
item = ListItem(List=end.Start, Index=0, Wrap=True)
item_2 = ListItem(List=end.Start, Index="-1", Wrap=True)
item_3 = ListItem(List=end.End, Index=0, Wrap=True)
item_4 = ListItem(List=end.End, Index="-1", Wrap=True)
ln_2 = Line(StartPoint=item, EndPoint=item_2)
ln_3 = Line(StartPoint=item_3, EndPoint=item_4)
extr = Extrude(Base=rectangle.Rectangle, Direction=rev_3)
cap = CapHoles(Brep=extr)
merge_2 = Merge(Data1=merge, Data2=ln_2, Data3=ln_3)
pshift = ShiftPaths(Data=cap, Offset=-1)
join = JoinCurves(Curves=merge_2, Preserve=False)  # -> simplify(Curves)
data_7 = Data()
entwine_2 = Entwine(Branch00=data_2, Branch01=xprod.Vector, FlattenInputs=True)  # -> simplify(Result)
pshift_2 = ShiftPaths(Data=join, Offset=-1)
item_5 = ListItem(List=data_7, Index=Slider(111, range=0..252), Wrap=True)
amp_2 = Amplitude(Vector=entwine_2, Amplitude=division)
rev_4 = Reverse(Vector=amp_2)
move_5 = Move(Geometry=pshift_2, Motion=amp_2)  # -> graft(Geometry), Transform
move_6 = Move(Geometry=pshift_2, Motion=rev_4)  # -> graft(Geometry), Transform
merge_3 = Merge(Data1=move_5.Geometry, Data2=move_6.Geometry)
loft = Loft(Curves=merge_3, Options={Adjust=False, Closed=False, LoftEnds=0, LoftSimp=0, LoftType=0, Rebuild=10, Refit=0.01})
cap_2 = CapHoles(Brep=loft)
pshift_3 = ShiftPaths(Data=cap_2, Offset=-1)
sdiff = SolidDifference(BrepsA=flatten(pshift_3))  # disabled
tstat = TreeStatistics(Tree=pshift_3)  # -> Paths, Length, Count
tstat_2 = TreeStatistics(Tree=pshift_3)  # -> Paths, Length, Count
item_6 = ListItem(List=tstat.Paths, Index=0, Wrap=True)
item_7 = ListItem(List=tstat_2.Paths, Index="-1", Wrap=True)
branch = TreeBranch(Tree=pshift_3, Path=item_7, MaintainPaths=True)
branch_2 = TreeBranch(Tree=pshift_3, Path=item_6, MaintainPaths=True)
sdiff_2 = SolidDifference()
