# Grasshopper definition 10WaffleStructure.gh (Grasshopper 1.0.7)
# plug-ins: ScriptParasite

srf = Surface(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)
旋转角度 = Slider(0, range=0..360)
u方向分割数 = Slider(15, range=0..20)
v方向分割数 = Slider(7, range=0..20)
高度 = Slider(100, range=0..300)
厚度 = Slider(20, range=0..100)
reverse = BooleanToggle(False)
data = Data(v方向分割数)
data_2 = Data(高度)
data_3 = Data(reverse)
data_4 = Data(srf)
data_5 = Data(旋转角度)
data_6 = Data(u方向分割数)
data_7 = Data(厚度)

scriptpar = ScriptParasite(Enable=Toggle(True), Folder="E:\Software\Rhino相关\07插件开发\KevinShopTest\10WaffleStructure")
c_script = CSharpScript()  # -> out, A
# ---------- c_script: C# ----------
    //test111
    //test
# ---------- end c_script ----------

area = Area(Geometry=data_4)  # -> Area, Centroid
xy = XYPlane(Origin=area.Centroid)
rotate = Rotate(Geometry=xy, Angle=degrees(data_5), Plane=PlaneXY(0, 0, 0))  # -> Geometry, Transform
bbox = BoundingBox(Content=data_4, Plane=rotate.Geometry)  # -> Box, Box_2
debox = DeconstructBox(Box=bbox.Box)  # -> Plane, X, Y, Z
wires = BrepWireframe(Brep=bbox.Box, Density=-1)
dedomain = DeconstructDomain(Domain=debox.Z)  # -> Start, End
item = ListItem(List=wires, Index=0, Wrap=True)  # -> Item, Item1, Item2, Item3
subtraction = Subtraction(A=dedomain.Start, B=dedomain.End)
flip = FlipCurve(Curve=item.Item2)  # -> Curve, Flag
flip_2 = FlipCurve(Curve=item.Item3)  # -> Curve, Flag
abs = Absolute(Value=subtraction)
divide = DivideCurve(Curve=item.Item, Count=data_6, Kinks=False)  # -> Points, Tangents, Parameters
divide_2 = DivideCurve(Curve=item.Item1, Count=data, Kinks=False)  # -> Points, Tangents, Parameters
divide_3 = DivideCurve(Curve=flip.Curve, Count=data_6, Kinks=False)  # -> Points, Tangents, Parameters
divide_4 = DivideCurve(Curve=flip_2.Curve, Count=data, Kinks=False)  # -> Points, Tangents, Parameters
ln = Line(StartPoint=divide_2.Points, EndPoint=divide_4.Points)
ln_2 = Line(StartPoint=divide.Points, EndPoint=divide_3.Points)
Z = UnitZ(Factor=abs)
extr = Extrude(Base=ln_2, Direction=Z)
extr_2 = Extrude(Base=ln, Direction=Z)
bbx = BrepBrep(BrepA=extr, BrepB=data_4)  # -> simplify(Curves), Points
neg = Negative(Value=data_2)
bbx_2 = BrepBrep(BrepA=extr_2, BrepB=data_4)  # -> simplify(Curves), Points
filter = StreamFilter(Gate=data_3, Stream0=data_2, Stream1=neg)
Z_2 = UnitZ(Factor=filter)
extr_3 = Extrude(Base=bbx_2.Curves, Direction=Z_2)  # -> flatten(Extrusion)
extr_4 = Extrude(Base=bbx.Curves, Direction=Z_2)  # -> flatten(Extrusion)

# ---- group: 0.5*厚度
division = Division(A=data_7, B="2")

# ---- group: 0.5*高度
division_2 = Division(A=data_2, B="2")

# ----
merge = Merge(Data1=flatten(extr_4), Data2=flatten(extr_3))  # -> flatten(Result)
data_8 = Data(merge)
area_2 = Area(Geometry=data_8)  # -> Area, Centroid
srf_cp = SurfaceClosestPoint(Point=area_2.Centroid, Surface=data_8)  # -> Point, UVPoint, Distance
evalsrf = EvaluateSurface(Surface=data_8, Point=srf_cp.UVPoint)  # -> Point, Normal, UDirection, VDirection, Frame

# ----
# 需要写一个C#电池把长度较长/短的分支选取出来
panel = Panel("E:\Software\Rhino相关\07插件开发\KevinShopTest\10WaffleStructure\partialFunction")

neg_2 = Negative(Value=division)
neg_3 = Negative(Value=division_2)
dom = ConstructDomain(DomainStart=neg_2, DomainEnd=division)

multiplication = Multiplication(A=neg_3, B=Slider(2, range=2..10))
abs_2 = Absolute(Value=multiplication)
addition = Addition(A=division_2, B=abs_2)

dom_2 = ConstructDomain(DomainStart=multiplication, DomainEnd=division_2)

ccx = CurveCurve(CurveA=bbx.Curves, CurveB=flatten(bbx_2.Curves))  # -> Points, ParamsA, ParamsB
clean = CleanTree(RemoveNulls=True, RemoveInvalid=True, RemoveEmpty=invert(False), Tree=ccx.Points)
deplane = DeconstructPlane(Plane=rotate.Geometry)  # -> Origin, XAxis, YAxis, ZAxis
pshift = ShiftPaths(Data=clean, Offset=-1)
pl = ConstructPlane(Origin=pshift, XAxis=deplane.YAxis, YAxis=deplane.ZAxis)
rectangle = Rectangle(Plane=pl, XSize=dom, YSize=dom_2, Radius=0)  # -> flatten(Rectangle), Length
Z_3 = UnitZ(Factor=addition)
data_9 = Data(simplify(graft(extr_4)))
move = Move(Geometry=rectangle.Rectangle, Motion=Z_3)  # -> Geometry, Transform
ccx_2 = CurveCurve(CurveA=data_9, CurveB=move.Geometry)  # -> Points, ParamsA, flatten(ParamsB)
partition = PartitionList(List=ccx_2.ParamsB, Size="2")  # -> simplify(Chunks)
pshift_2 = ShiftPaths(Data=ccx_2.ParamsA, Offset=-1)
shatter = Shatter(Curve=data_9, Parameters=pshift_2)  # -> simplify(Segments)
shatter_2 = Shatter(Curve=simplify(graft(move.Geometry)), Parameters=partition)  # -> simplify(Segments)
dispatch = Dispatch(List=shatter, DispatchPattern=[True, False])  # -> simplify(ListA), simplify(ListB)
dispatch_2 = Dispatch(List=shatter_2, DispatchPattern=[True, False])  # -> simplify(ListA), simplify(ListB)
c_script_2 = CSharpScript(crvsA=dispatch.ListA, crvsB=dispatch.ListB)  # -> out, shortCrvs, longCrvs; inputs crvsA: tree of Curve, crvsB: tree of Curve
# ---------- c_script_2: C# ----------
    DataTree<double> maxLengthOfCrvsA = calculateMaxLenth(crvsA);
    DataTree<double> maxLengthOfCrvsB = calculateMaxLenth(crvsB);

    DataTree<Curve> longCrvsTree = new DataTree<Curve>();
    DataTree<Curve> shortCrvsTree = new DataTree<Curve>();

    for (int i = 0; i < maxLengthOfCrvsA.BranchCount; i++)
    {
      if (maxLengthOfCrvsA.Branch(i)[0] > maxLengthOfCrvsB.Branch(i)[0])
      {
        longCrvsTree.AddRange(crvsA.Branch(i), new GH_Path(i));
        shortCrvsTree.AddRange(crvsB.Branch(i), new GH_Path(i));
      }
      else
      {
        longCrvsTree.AddRange(crvsB.Branch(i), new GH_Path(i));
        shortCrvsTree.AddRange(crvsA.Branch(i), new GH_Path(i));
      }
    }

    shortCrvs = shortCrvsTree;
    longCrvs = longCrvsTree;
# ---------- c_script_2: C# additional code ----------
  public DataTree<double> calculateMaxLenth(DataTree<Curve> crvs)
  {
    DataTree<double> maxLengthOfCrvs = new DataTree<double>();
    for (int i = 0; i < crvs.BranchCount; i++)
    {
      double maxLength = 0;
      for (int j = 0; j < crvs.Branch(i).Count; j++)
      {
        double currentLength = crvs.Branch(i)[j].GetLength();
        if (currentLength > maxLength)
        {
          maxLength = currentLength;
        }
      }
      maxLengthOfCrvs.Add(maxLength, new GH_Path(i));
    }
    return maxLengthOfCrvs;
  }
# ---------- end c_script_2 ----------
c_script_3 = CSharpScript(crvsA=dispatch_2.ListA, crvsB=dispatch_2.ListB)  # -> out, shortCrvs, longCrvs; inputs crvsA: tree of Curve, crvsB: tree of Curve; same code as c_script_2
unflatten = UnflattenTree(Tree=c_script_3.shortCrvs, Guide=dispatch.ListB)
merge_2 = Merge(Data1=unflatten, Data2=c_script_2.longCrvs)
join = JoinCurves(Curves=merge_2, Preserve=False)  # -> simplify(Curves)

ccx_3 = CurveCurve(CurveA=flatten(bbx.Curves), CurveB=bbx_2.Curves)  # -> Points, ParamsA, ParamsB
clean_2 = CleanTree(RemoveNulls=True, RemoveInvalid=True, RemoveEmpty=invert(False), Tree=ccx_3.Points)
pshift_3 = ShiftPaths(Data=clean_2, Offset=-1)
deplane_2 = DeconstructPlane(Plane=rotate.Geometry)  # -> Origin, XAxis, YAxis, ZAxis
pl_2 = ConstructPlane(Origin=pshift_3, XAxis=deplane_2.XAxis, YAxis=deplane_2.ZAxis)
rectangle_2 = Rectangle(Plane=pl_2, XSize=dom, YSize=dom_2, Radius=0)  # -> flatten(Rectangle), Length
data_10 = Data(simplify(graft(extr_3)))
ccx_4 = CurveCurve(CurveA=data_10, CurveB=rectangle_2.Rectangle)  # -> Points, ParamsA, flatten(ParamsB)
pshift_4 = ShiftPaths(Data=ccx_4.ParamsA, Offset=-1)
partition_2 = PartitionList(List=ccx_4.ParamsB, Size="2")  # -> simplify(Chunks)
shatter_3 = Shatter(Curve=data_10, Parameters=pshift_4)  # -> simplify(Segments)
shatter_4 = Shatter(Curve=simplify(graft(rectangle_2.Rectangle)), Parameters=partition_2)  # -> simplify(Segments)
dispatch_3 = Dispatch(List=shatter_3, DispatchPattern=[True, False])  # -> simplify(ListA), simplify(ListB)
dispatch_4 = Dispatch(List=shatter_4, DispatchPattern=[True, False])  # -> simplify(ListA), simplify(ListB)
c_script_4 = CSharpScript(crvsA=dispatch_3.ListA, crvsB=dispatch_3.ListB)  # -> out, shortCrvs, longCrvs; inputs crvsA: tree of Curve, crvsB: tree of Curve; same code as c_script_2
c_script_5 = CSharpScript(crvsA=dispatch_4.ListA, crvsB=dispatch_4.ListB)  # -> out, shortCrvs, longCrvs; inputs crvsA: tree of Curve, crvsB: tree of Curve; same code as c_script_2
unflatten_2 = UnflattenTree(Tree=c_script_5.shortCrvs, Guide=c_script_4.longCrvs)
merge_3 = Merge(Data1=unflatten_2, Data2=c_script_4.longCrvs)
join_2 = JoinCurves(Curves=merge_3, Preserve=False)  # -> simplify(Curves)

scriptpar_2 = ScriptParasite(Enable=Toggle(True), Folder=panel)
c_script_6 = CSharpScript(crvsA=dispatch_3.ListA, crvsB=dispatch_3.ListB)  # -> out, shortCrvs, longCrvs; inputs crvsA: tree of Curve, crvsB: tree of Curve; same code as c_script_2

merge_4 = Merge(Data1=flatten(join), Data2=flatten(join_2))  # -> flatten(Result)

amp = Amplitude(Vector=evalsrf.Normal, Amplitude=division)
amp_2 = Amplitude(Vector=evalsrf.Normal, Amplitude=division)
rev = Reverse(Vector=amp)
move_2 = Move(Geometry=merge_4, Motion=amp_2)  # -> Geometry, Transform
multiplication_2 = Multiplication(A=rev, B="2")
extr_5 = Extrude(Base=move_2.Geometry, Direction=multiplication_2)

cap = CapHoles(Brep=extr_5)
