# Grasshopper definition 14BeamFromAxisNet.gh (Grasshopper 1.0.7)
# plug-ins: ScriptParasite

extensionlength = Slider(3000, range=0..10000)
pt = Point(Point(3, 4, 0))
merge = Merge(Data1=Slider(6300, range=0..10000), Data2=Slider(3600, range=0..10000), Data3=Slider(5700, range=0..10000))
merge_2 = Merge(
    Data1=Slider(4800, range=0..10000),
    Data2=Slider(6900, range=0..10000),
    Data3=Slider(6000, range=0..10000),
    Data4=Slider(4200, range=0..10000))
data = Data(pt)
data_2 = Data(merge_2)
data_3 = Data(merge)
data_4 = Data(extensionlength)
data_5 = Data(Toggle(True))
data_6 = Data(Slider(4800, range=0..10000))
data_7 = Data(Slider(300, range=0..10000))
data_8 = Data(Toggle(False))
c_script = CSharpScript(
    datumPt=data,
    sizeX=data_2,
    sizeY=data_3,
    extensionLength=data_4,
    createColumns=data_5,
    heightOfColumn=data_6,
    radiusOfColumn=data_7,
    isCircle=data_8)  # -> out, outVerticalLines, outHorizontalLines, outPts, outColumns; inputs datumPt: Point3d, sizeX: list of Double, sizeY: list of Double, extensionLength: Double, createColumns: Boolean, heightOfColumn: Double, radiusOfColumn: Double, isCircle: Boolean
# ---------- c_script: C# usings ----------
using Rhino.Geometry.Intersect;
# ---------- c_script: C# ----------
    List<Curve> verticalLines = new List<Curve>();
    List<Curve> horizontalLines = new List<Curve>();
    DataTree<Point3d> centerPts = new DataTree<Point3d>();
    DataTree<Brep> columns = new DataTree<Brep>();

    double lengthOfVLine = extensionLength * 2;
    double lengthOfHLine = extensionLength * 2;
    for (int i = 0; i < sizeX.Count; i++)
    {
      lengthOfHLine += sizeX[i];
    }
    for (int i = 0; i < sizeY.Count; i++)
    {
      lengthOfVLine += sizeY[i];
    }

    CreateLines(datumPt, sizeX, 0, extensionLength, lengthOfVLine, ref verticalLines);
    CreateLines(datumPt, sizeY, 1, extensionLength, lengthOfHLine, ref horizontalLines);

    if(createColumns==true)
    {
      CreateColumns(verticalLines, horizontalLines, heightOfColumn, radiusOfColumn, isCircle, ref centerPts, ref columns);
    }

    outVerticalLines = verticalLines;
    outHorizontalLines = horizontalLines;
    outPts = centerPts;
    outColumns = columns;
# ---------- c_script: C# additional code ----------
  //direction==0,create verticle lines along X axis
  //direction==1,create horizontal lines along Y axis
  public void CreateLines(Point3d datumPt,List<double> sizeList,int direction,double extensionLength,double lengthOfLine,ref List<Curve> resultLines)
  {
    for (int i = 0; i <= sizeList.Count; i++)
    {
      Point3d startPt = new Point3d(datumPt);
      double delta = extensionLength;
      int flagX = 1;
      int flagY = 0;
      for (int j = 0; j < i; j++)
      {
        delta += sizeList[j];
      }
      if(direction==1)
      {
        flagX = 0;
        flagY = 1;
      }
      startPt.Transform(Transform.Translation(flagX * delta, flagY * delta, 0));
      Point3d endPt = new Point3d(startPt);
      endPt.Transform(Transform.Translation(flagY * lengthOfLine, flagX * lengthOfLine, 0));
      Curve resultLine = new Line(startPt, endPt).ToNurbsCurve();
      resultLines.Add(resultLine);
    }
  }

  public void CreateColumns(List<Curve> verticalLines,List<Curve> horizontalLines,double heightOfColumn,double radiusOfColumn,bool isCircle,ref DataTree<Point3d> centerPts,ref DataTree<Brep> columns)
  {
    for (int i = 0; i < verticalLines.Count; i++)
    {
      for (int j = 0; j < horizontalLines.Count; j++)
      {
        CurveIntersections intersections = Intersection.CurveCurve(verticalLines[i], horizontalLines[j], 0.1, 0.1);
        for (int k = 0; k < intersections.Count; k++)
        {
          Point3d centerPt = intersections[k].PointA;
          centerPts.Add(centerPt, new GH_Path(i));

          Plane plane = new Plane(centerPt, Vector3d.XAxis, Vector3d.YAxis);
          Curve baseCurve;
          if (isCircle)
          {
            baseCurve = new Circle(centerPt, radiusOfColumn).ToNurbsCurve();
          }
          else
          {
            Interval edge = new Interval(-radiusOfColumn, radiusOfColumn);
            baseCurve = new Rectangle3d(plane, edge, edge).ToNurbsCurve();
          }
          Brep column = Surface.CreateExtrusion(baseCurve, new Vector3d(0, 0, heightOfColumn)).ToBrep().CapPlanarHoles(0.1);
          columns.Add(column, new GH_Path(i));
        }
      }
    }
  }
# ---------- end c_script ----------

beamwidth = Slider(400, range=0..1000)
type = BooleanToggle(True)
beamheight = Slider(600, range=0..1000)
data_9 = Data(beamheight)
data_10 = Data(beamwidth)
data_11 = Data(type)

c_script_2 = CSharpScript(
    verticalLines=c_script.outVerticalLines,
    horizontalLines=c_script.outHorizontalLines,
    extensionLength=data_4,
    heightOfColumn=data_6,
    beamHeight=data_9,
    beamWidth=data_10,
    type=data_11)  # -> out, outVerticalBeams, outHorizontalBeams; inputs verticalLines: list of Curve, horizontalLines: list of Curve, extensionLength: Double, heightOfColumn: Double, beamHeight: Double, beamWidth: Double, type: Boolean
# ---------- c_script_2: C# ----------
    //trim the both curve end to get the beam baseCurve in the real length
    TrimLines(extensionLength, ref verticalLines);
    TrimLines(extensionLength, ref horizontalLines);

    //move the curve to the top of the column
    for (int i = 0; i < verticalLines.Count; i++)
    {
      verticalLines[i].Transform(Transform.Translation(0, 0, heightOfColumn));
    }
    for (int i = 0; i < horizontalLines.Count; i++)
    {
      horizontalLines[i].Transform(Transform.Translation(0, 0, heightOfColumn));
    }

    List<Brep> verticalBeams = new List<Brep>();
    List<Brep> horizontalBeams = new List<Brep>();
    CreateBeams(verticalLines, beamHeight, beamWidth, type, ref verticalBeams);
    CreateBeams(horizontalLines, beamHeight, beamWidth, type, ref horizontalBeams);

    outVerticalBeams = verticalBeams;
    outHorizontalBeams = horizontalBeams;
# ---------- c_script_2: C# additional code ----------
  public void TrimLines(double extensionLength,ref List<Curve> lines)
  {
    for (int i = 0; i < lines.Count; i++)
    {
      lines[i] = lines[i].Trim(CurveEnd.Both, extensionLength);
    }
  }

  public void CreateBeams(List<Curve> beamLines, double beamHeight,double beamWidth,bool type,ref List<Brep> beams)
  {
    double flag = 1;
    if (type == false)
      flag = -1;

    
    for (int i = 0; i < beamLines.Count; i++)
    {
      Curve curve1 = beamLines[i].Offset(Plane.WorldXY, beamWidth / 2, 0.1, CurveOffsetCornerStyle.Sharp)[0];
      Curve curve2 = beamLines[i].Offset(Plane.WorldXY, -beamWidth / 2, 0.1, CurveOffsetCornerStyle.Sharp)[0];
      Curve curve3 = new Line(curve1.PointAtStart, curve2.PointAtStart).ToNurbsCurve();
      Curve curve4 = new Line(curve1.PointAtEnd, curve2.PointAtEnd).ToNurbsCurve();

      Curve baseCurve = Curve.JoinCurves(new List<Curve> { curve1, curve2, curve3, curve4 }, 0.1)[0];
      Brep beam = Surface.CreateExtrusion(baseCurve, new Vector3d(0, 0, beamHeight * flag)).ToBrep().CapPlanarHoles(0.1);

      beams.Add(beam);
    }
  }
# ---------- end c_script_2 ----------
scriptpar = ScriptParasite(Enable=Toggle(True), Folder="D:\软件\Rhino相关\KevinShopTest\14BeamFromAxisNet")
