# Grasshopper definition 15TileRoof.gh (Grasshopper 1.0.7)

屋脊曲线内缩值 = Slider(0, range=0..1000)
瓦当厚度 = Slider(30, range=0..100)
pt = Point(Point(-0.1834637477, 0.3575867163, 0))
屋面长度 = Slider(6300, range=0..10000)
屋面宽度 = Slider(2400, range=0..10000)
屋脊高度 = Slider(1000, range=0..1000)
凸瓦片列数 = Slider(15, range=2..100)
每列瓦片个数 = Slider(10, range=0..100)
瓦片厚度 = Slider(6, range=0..100)
瓦片突出屋檐距离 = Slider(60, range=0..100)
data = Data(屋面宽度)
data_2 = Data(凸瓦片列数)
data_3 = Data(瓦片突出屋檐距离)
data_4 = Data(瓦当厚度)
data_5 = Data(pt)
data_6 = Data(屋面长度)
data_7 = Data(屋脊高度)
data_8 = Data(屋脊曲线内缩值)
data_9 = Data(每列瓦片个数)
data_10 = Data(瓦片厚度)

# ---- group: 生成瓦片列中心线
expression = Expression(x=data, y=data_7, Expression="(x²-y²)^0.5")
rectangle = Rectangle(Plane=data_5, XSize=data_6, YSize=expression, Radius=0)  # -> Rectangle, Length
Z = UnitZ(Factor=data_7)
explode = Explode(Curve=rectangle.Rectangle, Recursive=True)  # -> Segments, Vertices
item = ListItem(List=explode.Segments, Index=0, Wrap=True)  # -> Item, Item1, Item2
move = Move(Geometry=item.Item2, Motion=Z)  # -> Geometry, Transform
expression_2 = Expression(x=data_2, Expression="x-1")
neg = Negative(Value=data_8)
flip = FlipCurve(Curve=move.Geometry)  # -> Curve, Flag
屋檐曲线 = Data(item.Item)
ext = ExtendCurve(Curve=flip.Curve, Type=0, Start=neg, End=neg)

# ---- group: 生成瓦片列中心线 / 瓦片总列数
addition = Addition(A=data_2, B=expression_2)

# ----
屋脊曲线 = Data(ext)

# ---- group: 生成瓦片列中心线 (continued)
divide = DivideCurve(Curve=屋檐曲线, Count=addition, Kinks=False)  # -> Points, Tangents, Parameters
shatter = Shatter(Curve=屋檐曲线, Parameters=divide.Parameters)
divide_2 = DivideCurve(Curve=屋脊曲线, Count=addition, Kinks=False)  # -> Points, Tangents, Parameters
shatter_2 = Shatter(Curve=屋脊曲线, Parameters=divide_2.Parameters)
midpt = CurveMiddle(Curve=shatter)
midpt_2 = CurveMiddle(Curve=shatter_2)
ln = Line(StartPoint=midpt, EndPoint=midpt_2)
ext_2 = ExtendCurve(Curve=ln, Type=0, Start=data_3, End="0")
data_11 = Data(ext_2)

# ---- group: 基础屋面
end = EndPoints(Curve=屋檐曲线)  # -> Start, End
end_2 = EndPoints(Curve=屋脊曲线)  # -> Start, End
ln_2 = Line(StartPoint=end.Start, EndPoint=end_2.Start)
ln_3 = Line(StartPoint=end.End, EndPoint=end_2.End)
merge = Merge(Data1=屋檐曲线, Data2=ln_2, Data3=ln_3, Data4=屋脊曲线)
join = JoinCurves(Curves=merge, Preserve=False)
boundary = BoundarySurfaces(Edges=join)

# ---- group: 生成瓦片列中心线
len = Length(Curve=shatter)
item_2 = ListItem(List=len, Index=0, Wrap=True)
expression_3 = Expression(x=item_2, Expression="x/2")
expression_4 = Expression(x=data_10, Expression="x/2")

len_2 = Length(Curve=shatter_2)
item_3 = ListItem(List=len_2, Index=0, Wrap=True)
expression_5 = Expression(x=data_10, Expression="x/2")
expression_6 = Expression(x=item_3, Expression="x/2")

# ---- group: 生成瓦片列中心线 / 屋檐曲线瓦片半径
subtraction = Subtraction(A=expression_3, B=expression_4)

# ---- group: 生成瓦片列中心线 / 屋脊曲线瓦片半径
subtraction_2 = Subtraction(A=expression_6, B=expression_5)

# ---- group: 生成基础面 / 分割平面
divide_3 = DivideCurve(Curve=data_11, Count=data_9, Kinks=False)  # -> Points, Tangents, Parameters
crv_cp = CurveClosestPoint(Point=simplify(divide_3.Points), Curve=simplify(graft(data_11)))  # -> Point, simplify(Parameter), Distance
eval = EvaluateCurve(Curve=simplify(graft(data_11)), Parameter=crv_cp.Parameter)  # -> simplify(Point), simplify(Tangent), Angle
pl = PlaneNormal(Origin=eval.Point, ZAxis=eval.Tangent)

# ---- group: 生成基础面
midpt_3 = CurveMiddle(Curve=data_11)
crv_cp_2 = CurveClosestPoint(Point=midpt_3, Curve=data_11)  # -> Point, Parameter, Distance
end_3 = EndPoints(Curve=data_11)  # -> Start, End
eval_2 = EvaluateCurve(Curve=data_11, Parameter=crv_cp_2.Parameter)  # -> Point, Tangent, Angle
pl_2 = PlaneNormal(Origin=end_3.Start, ZAxis=eval_2.Tangent)
pl_3 = PlaneNormal(Origin=end_3.End, ZAxis=eval_2.Tangent)
panel = Panel("""270
90""")
arc = Arc(Plane=pl_2, Radius=subtraction, Angle=Domain(0, 3.141592654))  # -> Arc, Length
arc_2 = Arc(Plane=pl_3, Radius=subtraction_2, Angle=Domain(0, 3.141592654))  # -> Arc, Length
long = LongestList(ListA=arc.Arc, ListB=panel, PaddingMode=4)  # -> ListA, ListB
rotate = Rotate(Geometry=arc_2.Arc, Angle=degrees(long.ListB), Plane=pl_3)  # -> Geometry, Transform
rotate_2 = Rotate(Geometry=arc.Arc, Angle=degrees(long.ListB), Plane=pl_2)  # -> Geometry, Transform
merge_2 = Merge(Data1=simplify(graft(rotate_2.Geometry)), Data2=simplify(graft(rotate.Geometry)))
neg_2 = Negative(Value=data_10)
loft = Loft(Curves=merge_2, Options={Adjust=False, Closed=False, LoftEnds=0, LoftSimp=0, LoftType=0, Rebuild=10, Refit=0.01})
sec = BrepPlane(Brep=loft, Plane=pl)  # -> Curves, Points
pshift = ShiftPaths(Data=sec.Curves, Offset=-1)
srfsplit = SurfaceSplit(Surface=loft, Curves=pshift)  # -> simplify(graft(Fragments))

# ---- group: 生成瓦当
pln = Plane(pl_2)
vec = Vector(eval_2.Tangent)
expression_7 = Expression(x=subtraction, Expression="x/3")
cir = Circle(Plane=pln, Radius=subtraction)
neg_3 = Negative(Value=expression_7)
expression_8 = Expression(x=data_4, Expression="x/3")
offset = OffsetCurve(Curve=cir, Distance=data_10, Plane=pln, Corners=1)  # -> simplify(Curve)
amp = Amplitude(Vector=graft(vec), Amplitude=data_4)  # -> simplify(Vector)
amp_2 = Amplitude(Vector=graft(vec), Amplitude=expression_8)  # -> simplify(Vector)
offset_2 = OffsetCurve(Curve=flatten(offset), Distance=neg_3, Plane=pln, Corners=1)  # -> simplify(Curve)
rev = Reverse(Vector=amp)
move_2 = Move(Geometry=offset, Motion=rev)  # -> Geometry, Transform
move_3 = Move(Geometry=offset_2, Motion=rev)  # -> Geometry, Transform
move_4 = Move(Geometry=move_3.Geometry, Motion=amp_2)  # -> Geometry, Transform
merge_3 = Merge(Data1=offset, Data2=move_2.Geometry, Data3=move_3.Geometry, Data4=move_4.Geometry)
loft_2 = Loft(Curves=merge_3, Options={Adjust=False, Closed=False, LoftEnds=0, LoftSimp=0, LoftType=0, Rebuild=10, Refit=0.01})
cap = CapHoles(Brep=loft_2)
dispatch = Dispatch(List=flatten(cap), DispatchPattern=[True, False])  # -> ListA, ListB
data_12 = Data(simplify(graft(dispatch.ListA)))

# ---- group: 生成形体
offset_3 = OffsetSurface(Surface=srfsplit, Distance=neg_2, Retrim=True)
merge_4 = Merge(Data1=srfsplit, Data2=offset_3)
loft_3 = Loft(Curves=merge_4, Options={Adjust=False, Closed=False, LoftEnds=0, LoftSimp=0, LoftType=0, Rebuild=10, Refit=0.01})
merge_5 = Merge(Data1=merge_4, Data2=loft_3)
join_2 = BrepJoin(Breps=merge_5)  # -> Breps, Closed
pshift_2 = ShiftPaths(Data=join_2.Breps, Offset=-1)

# ----
merge_6 = Merge(Data1=pshift_2, Data2=data_12)
group = Group(Objects=merge_6)
