# Grasshopper definition 17RotatedIterativeBoxV2.gh (Grasshopper 1.0.7)
# plug-ins: ScriptParasite

pt = Point(Point(3816.769649, -1507, 637.0967114))
panel = Panel("E:\Software\Rhino相关\07插件开发\KevinShopTest\17RotatedIterativeBoxV2")
data = Data(Slider(25, range=0..100))
data_2 = Data(Slider(4, range=0..360))
data_3 = Data(Slider(12, range=0..100))
data_4 = Data(pt)
data_5 = Data(Slider(1200, range=0..10000))

c_script = CSharpScript(centerPt=data_4, length=data_5, radiusOfPipe=data, angle=data_2, count=data_3)  # -> out, outCrvs, outPipes; inputs centerPt: Point3d, length: Double, radiusOfPipe: Double, angle: Double, count: Int32
# ---------- c_script: C# usings ----------
using Grasshopper.Kernel.Types.Transforms;
# ---------- c_script: C# ----------
    if (length<=0 || radiusOfPipe <= 0 || count <= 0)
    {
      Print("Invalid radius value");
      return;
    }
    angle = RhinoMath.ToRadians(angle);

    Plane basePlane = new Plane(centerPt, Vector3d.ZAxis);
    Interval intervalLength = new Interval(-length / 2, length / 2);
    Box originBox = new Box(basePlane, intervalLength, intervalLength, intervalLength);

    Curve[] wireframes = originBox.ToBrep().GetWireframe(0);
    List<Curve> wireframeCrvsList = new List<Curve>();
    wireframeCrvsList.AddRange(wireframes);

    //创建旋转的transform
    ITransform transform1 = new Rotation(centerPt, Vector3d.XAxis, angle);
    ITransform transform2 = new Rotation(centerPt, -1 * Vector3d.YAxis, angle);
    ITransform transform3 = new Rotation(centerPt, Vector3d.ZAxis, angle);
    List<GH_Transform> resourceForms = new List<GH_Transform>();
    resourceForms.Add(new GH_Transform(transform1));
    resourceForms.Add(new GH_Transform(transform2));
    resourceForms.Add(new GH_Transform(transform3));
    //合并旋转的transform
    GH_Transform compoundTransform = new GH_Transform();
    foreach (GH_Transform resourceForm in resourceForms)
    {
      foreach (ITransform transform in resourceForm.CompoundTransforms)
      {
        compoundTransform.CompoundTransforms.Add(transform.Duplicate());
      }
    }
    compoundTransform.ClearCaches();

    //通过旋转的transform创建旋转一定角度的盒子(旋转盒)
    GH_Brep rotatedBrep = new GH_Brep(originBox.ToBrep());
    rotatedBrep.Transform(compoundTransform.Value);
    
    GH_Box innerGhBox = new GH_Box(originBox);
    //获得旋转盒的包围盒(以世界坐标为基准)
    GH_Box outterGhBox = new GH_Box(GH_Brep.BrepTightBoundingBox(rotatedBrep.Value));
    //通过内外两个包围盒获得缩放值
    double scaleFactor = Math.Abs((innerGhBox.Value.X.Max - innerGhBox.Value.X.Min) / (outterGhBox.Value.X.Max - outterGhBox.Value.X.Min));

    //创建缩放的transform
    ITransform transform4 = new Scale(centerPt, scaleFactor);
    //合并缩放的transform
    compoundTransform.CompoundTransforms.Add(transform4.Duplicate());
    compoundTransform.ClearCaches();

    //调用递归方法创建基准线
    DataTree<Curve> iterativeCrvs= new DataTree<Curve>();
    CreateIterativeCrvs(iterativeCrvs, wireframeCrvsList, compoundTransform, count);

    DataTree<Brep> iterativePipes = CreateIterativePipes(iterativeCrvs, radiusOfPipe,scaleFactor);

    outCrvs = iterativeCrvs;
    outPipes = iterativePipes;
# ---------- c_script: C# additional code ----------
  public void CreateIterativeCrvs(DataTree<Curve> iterativeCrvsTree,List<Curve> wireframeCrvsList, GH_Transform compoundTransform, int count)
  {
    //基线条件
    if (count == 1)
    {
      List<Curve> iterativeCrvsList = new List<Curve>();
      for (int i = 0; i < wireframeCrvsList.Count; i++)
      {
        Curve crv = wireframeCrvsList[i].DuplicateCurve();
        iterativeCrvsList.Add(crv);
      }
      iterativeCrvsTree.AddRange(iterativeCrvsList, new GH_Path(count-1));
    }
    else
    {
      List<Curve> iterativeCrvs = new List<Curve>();
      for (int i = 0; i < wireframeCrvsList.Count; i++)
      {
        Curve crv = wireframeCrvsList[i].DuplicateCurve();
        iterativeCrvs.Add(crv);
      }
      for (int i = 0; i < iterativeCrvs.Count; i++)
      {
        Curve crv = iterativeCrvs[i].DuplicateCurve();
        iterativeCrvsTree.Add(crv, new GH_Path(count - 1));
      }

      for (int i = 0; i < iterativeCrvs.Count; i++)
      {
        iterativeCrvs[i].Transform(compoundTransform.Value);
      }
      
      CreateIterativeCrvs(iterativeCrvsTree,iterativeCrvs,compoundTransform,count-1);
    }
  }

  public DataTree<Brep> CreateIterativePipes(DataTree<Curve> iterativeCrvs,double radiusOfPipe,double scaleFactor)
  {
    DataTree<Brep> iterativePipes = new DataTree<Brep>();
    for (int i = 0; i < iterativeCrvs.BranchCount; i++)
    {
      for (int j = 0; j < iterativeCrvs.Branch(i).Count; j++)
      {
        int countOfScale = iterativeCrvs.BranchCount - i - 1;
        double actualScaleFactor = 1.0;
        for (int k = 0; k < countOfScale; k++)
        {
          actualScaleFactor = actualScaleFactor * scaleFactor;
        }
        Brep pipe = Brep.CreatePipe(iterativeCrvs.Branch(i)[j], radiusOfPipe*actualScaleFactor, true, PipeCapMode.Round, true, RhinoDoc.ActiveDoc.ModelAbsoluteTolerance, RhinoDoc.ActiveDoc.ModelAngleToleranceRadians)[0];
        iterativePipes.Add(pipe, new GH_Path(i));
      }
    }
    return iterativePipes;
  }
# ---------- end c_script ----------
scriptpar = ScriptParasite(Enable=Toggle(True), Folder=panel)

tstat = TreeStatistics(Tree=c_script.outPipes)  # -> Paths, Length, Count
series = Series(Start=0, Step=1, Count=tstat.Count)
expression = Expression(x=tstat.Count, Expression="x-1")
gradient = Gradient(
    LowerLimit=0,
    UpperLimit=expression,
    Parameter=series,
    stops=[0: RGB(234, 38, 0), 0.25: RGB(234, 126, 0), 0.5: RGB(254, 244, 84), 0.75: RGB(173, 203, 249), 1: RGB(75, 107, 169)])
preview = CustomPreview(Geometry=c_script.outPipes, Material=simplify(graft(gradient)))
