# Grasshopper definition demo.gh (Grasshopper 1.0.7)
# plug-ins: ScriptParasite, Kangaroo2 Components

c_script = CSharpScript(num=Slider(28, range=0..50))  # -> out, OutCurves, OutSurface, OutLoft, OutPoints; inputs num: Int32
# ---------- c_script: C# ----------
    //list of all points
    List<Point3d> allPoints = new List<Point3d>();
    //list of curves
    List<Curve> curves = new List<Curve>();

    for (int y = 0; y < num; y++)
    {
      //curve points
      List<Point3d> crvPoints = new List<Point3d>();
      for (int x = 0; x < num; x++)
      {
        double z = Math.Sin(Math.PI + (x + y));
        Point3d pt = new Point3d(x, y, z);
        crvPoints.Add(pt);
        allPoints.Add(pt);
      }
      //create a degree 3 nurbs curve from control points
      NurbsCurve crv = (NurbsCurve)Curve.CreateControlPointCurve(crvPoints, 3);
      curves.Add(crv);
    }
    //create a nurbs surface from control points
    NurbsSurface srf = NurbsSurface.CreateFromPoints(allPoints, num, num, 3, 3);

    //create a loft brep from curves
    Brep[] breps = Brep.CreateFromLoft(curves, Point3d.Unset, Point3d.Unset, LoftType.Tight, false);

    //Assign output
    OutCurves = curves;
    OutSurface = srf;
    OutLoft = breps;
    OutPoints = allPoints;
# ---------- end c_script ----------
scriptpar = ScriptParasite(Enable=Toggle(True), Folder="D:\软件\Rhino相关\KevinShopTest\02Learn")

data = Data(c_script.OutSurface)
data_2 = Data(c_script.OutCurves)
data_3 = Data(c_script.OutPoints)
data_4 = Data(c_script.OutLoft)
pt = Point([Point(0, 0, 0), Point(0, 30, 0), Point(35, 25, 0), Point(44.93043011, -0.06200809814, 13.6614161)])

c_script_2 = CSharpScript(bezierPts=pt, segments=Slider(5, range=0..100))  # -> out, BezierCrv; inputs bezierPts: list of Point3d, segments: Int32
# ---------- c_script_2: C# ----------
    if (segments < 2)
      segments = 2;

    List<Point3d> evalPts = new List<Point3d>();
    double step = 1.0 / (double)segments;

    for (int i = 0; i <= segments; i++)
    {
      double t = i * step;
      Point3d pt = Point3d.Unset;
      EvalPoint(bezierPts, t, ref pt);
      if (pt.IsValid)
        evalPts.Add(pt);
    }

    Polyline pline = new Polyline(evalPts);
    BezierCrv = pline;
# ---------- c_script_2: C# additional code ----------
  public void EvalPoint(List<Point3d> points, double t, ref Point3d evalPt)
  {
    //stopping condition - point at parameter t is found
    if (points.Count < 2)
      return;

    List<Point3d> tPoints = new List<Point3d>();

    for (int i = 1; i < points.Count; i++)
    {
      Line line = new Line(points[i - 1], points[i]);
      Point3d pt = line.PointAt(t);
      tPoints.Add(pt);
    }
    if (tPoints.Count == 1)
      evalPt = tPoints[0];
    EvalPoint(tPoints, t, ref evalPt);
  }
# ---------- end c_script_2 ----------
scriptpar_2 = ScriptParasite(Enable=Toggle(True), Folder="D:\软件\Rhino相关\KevinShopTest\03BezirCurve")

nurbs = NurbsCurve(Vertices=pt, Degree=3, Periodic=False)  # -> Curve, Length, Domain
crv = Curve(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)
srf = Surface(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)
disc = Discontinuity(Curve=crv, Level=1)  # -> Points, Parameters
pline = PolyLine(Vertices=disc.Points, Closed=invert(False))
area = Area(Geometry=pline)  # -> Area, Centroid
scale = Scale(Geometry=pline, Center=area.Centroid, Factor=0.5)  # -> Geometry, Transform
merge = Merge(Data1=pline, Data2=scale.Geometry)

c_script_3 = CSharpScript(srf=srf, inPolyline=merge, degree=Slider(2, range=0..6))  # -> out, OutPolylines, OutMesh, A; inputs srf: Surface, inPolyline: list of Polyline, degree: Int32
# ---------- c_script_3: C# ----------
    //instantiate the collection of all panels
    List<Polyline> outPanels = new List<Polyline>();

    //limit to 6 subdivisions
    if (degree > 6)
      degree = 6;
    for (int i = 0; i < degree; i++)
    {
      //outer polylines
      List<Polyline> plines = new List<Polyline>();
      //mid polylines
      List<Polyline> midPlines = new List<Polyline>();
      //generate subdivided panels
      bool result = SubPanelOnSurface(srf, inPolyline.ToArray(), ref plines, ref midPlines);
      if (result == false)
        break;

      //add outer panels
      outPanels.AddRange(plines);
      //add mid panels only in the last iteration
      if (i == degree - 1)
        outPanels.AddRange(midPlines);
      else //subdivede mid panels only
        inPolyline = midPlines;

      A = midPlines;
    }

    //create a mesh from all polylines
    Mesh joinedMesh = new Mesh();
    for (int i = 0; i < outPanels.Count; i++)
    {
      Mesh mesh = Mesh.CreateFromClosedPolyline(outPanels[i]);
      joinedMesh.Append(mesh);
    }

    //make sure all mesh faces normals are  in the same general direction
    joinedMesh.UnifyNormals();

    //assign output
    OutPolylines = outPanels;
    OutMesh = joinedMesh;
# ---------- c_script_3: C# additional code ----------
  public bool SubPanelOnSurface(Surface srf,Polyline[] inputPanels, ref List<Polyline> outPanels,ref List<Polyline> midPanels)
  {
    //check for a valid input
    if (inputPanels.Length == 0 || null == srf)
      return false;

    for (int i = 0; i < inputPanels.Length; i++)
    {
      Polyline ipline = inputPanels[i];
      if (!ipline.IsValid || !ipline.IsClosed)
        continue;

      //stack of points
      List<Point3d> stack = new List<Point3d>();
      Polyline newPline = new Polyline();

      for (int j = 1; j < ipline.Count; j++)
      {
        Line line = new Line(ipline[j - 1], ipline[j]);
        if (line.IsValid)
        {
          Point3d mid = line.PointAt(0.5);
          double s, t;
          srf.ClosestPoint(mid,out s, out t);
          mid = srf.PointAt(s, t);
          newPline.Add(mid);
          stack.Add(ipline[j - 1]);
          stack.Add(mid);
        }
      }

      //add the first 2 point to close last triangle
      stack.Add(stack[0]);
      stack.Add(stack[1]);

      //close
      newPline.Add(newPline[0]);
      midPanels.Add(newPline);

      for (int j = 2; j < stack.Count; j++)
      {
        Polyline pl = new Polyline(new List<Point3d> { stack[j - 2], stack[j - 1], stack[j], stack[j - 2] });
        outPanels.Add(pl);
      }
    }
    return true;
  }
# ---------- end c_script_3 ----------
scriptpar_3 = ScriptParasite(Enable=Toggle(True), Folder="D:\软件\Rhino相关\KevinShopTest\04SubdivisionMesh")

data_5 = Data(c_script_3.OutMesh)
pt_2 = Point(Point(40, -20, 0))
sqgrid = Square(Plane=PlaneXY(0, 0, 0), Size=Slider(20, range=0..100), ExtentX=Slider(9, range=0..100), ExtentY=Slider(5, range=0..10))  # -> Cells, simplify(Points)
data_6 = Data(graft(sqgrid.Points))
panel = Panel(data_6)

scriptpar_4 = ScriptParasite(Enable=Toggle(True), Folder="D:\软件\Rhino相关\KevinShopTest\05DataTreeTest")
c_script_4 = CSharpScript(pts=data_6, otherPt=pt_2)  # -> out, A, B, C, D, E, F, AA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; inputs pts: tree of Point3d, otherPt: Point3d
# ---------- c_script_4: C# ----------
    pts.Insert(otherPt,new GH_Path(2,1),pts.Branch(2,1).Count);
    A = pts.BranchCount;
    B = pts.Branches;
    C = pts.DataCount;
    D = pts.Path(0);
    E = pts.TopologyDescription;
    F = pts.Branch(2,1);
    AA = pts.Branches[11];
    AB = pts.Branches[pts.BranchCount - 1];
    AC = pts.Paths;
    string mask = "0;{i};0";
    pts.RenumberPaths(mask);
    AD = pts;
    pts.RenumberPaths();
    AE = pts;
    AF = pts.AllData();
# ---------- end c_script_4 ----------

viewer = ParamViewer(data_6)
panel_2 = Panel(c_script_4.A)
data_7 = Data(c_script_4.AF)
data_8 = Data(c_script_4.B)
data_9 = Data(c_script_4.C)
data_10 = Data(c_script_4.D)
data_11 = Data(c_script_4.AB)
data_12 = Data(c_script_4.AD)
data_13 = Data(c_script_4.AC)
data_14 = Data(c_script_4.AE)
data_15 = Data(c_script_4.E)
data_16 = Data(c_script_4.F)
data_17 = Data(c_script_4.AA)
panel_3 = Panel(data_17)
panel_4 = Panel(data_10)
panel_5 = Panel(data_8)
panel_6 = Panel(data_9)
panel_7 = Panel(data_16)
panel_8 = Panel(data_15)
alignfaces = AlignFaces(Flip=False, Strength=1)
pt_3 = Point(Point(4, -12, 0))

# ---- group: 百叶窗
scriptpar_5 = ScriptParasite(Enable=Toggle(True), Folder="D:\软件\Rhino相关\KevinShopTest\07GH_Structure")
c_script_5 = CSharpScript(
    datumPt=pt_3,
    width=Slider(600, range=0..1000),
    height=Slider(900, range=0..1000),
    depth=Slider(60, range=0..1000),
    widthOfFrame=Slider(50, range=0..100),
    depthOfGlass=Slider(20, range=0..100),
    countOfShutter=Slider(19, range=0..100),
    angleOfShutter=Slider(128, range=0..360))  # -> out, outWindowFrame, outGlass, outShutters; inputs datumPt: Point3d, width: Double, height: Double, depth: Double, widthOfFrame: Double, depthOfGlass: Double, countOfShutter: Int32, angleOfShutter: Int32
# ---------- c_script_5: C# ----------
    Brep windowFrame = CreateWindowFrame(datumPt, width, height, depth, widthOfFrame);

    Brep glass = CreateGlass(datumPt, width, height, depth, widthOfFrame, depthOfGlass);

    List<Brep> shutters = CreateShutters(datumPt, width, height, depth, widthOfFrame, depthOfGlass, countOfShutter, angleOfShutter);

    outWindowFrame = windowFrame;
    outGlass = glass;
    outShutters = shutters;
# ---------- c_script_5: C# additional code ----------
  public Brep CreateWindowFrame(Point3d datumPt, double width, double height, double depth, double widthOfFrame)
  {
    Brep windowFrame = new Brep();
    Curve baseCurve = new Rectangle3d(new Plane(datumPt, Vector3d.XAxis, Vector3d.ZAxis), width, height).ToNurbsCurve();
    Brep outterBrep = Surface.CreateExtrusion(baseCurve, Vector3d.YAxis * depth).ToBrep().CapPlanarHoles(0.01);

    Plane offsetPlane;
    baseCurve.TryGetPlane(out offsetPlane);
    Curve innerCurve = baseCurve.Offset(offsetPlane, -1*widthOfFrame, 0.01, CurveOffsetCornerStyle.Sharp)[0];
    Brep innerBrep = Surface.CreateExtrusion(innerCurve, Vector3d.YAxis * depth).ToBrep().CapPlanarHoles(0.01);

    windowFrame = Brep.CreateBooleanDifference(outterBrep, innerBrep, 0.01, false)[0];
    return windowFrame;
  }

  public Brep CreateGlass(Point3d datumPt, double width, double height, double depth, double widthOfFrame, double depthOfGlass)
  {
    Brep glass = new Brep();
    depthOfGlass = Math.Min(depth, depthOfGlass);

    Curve baseCurve = new Rectangle3d(new Plane(datumPt, Vector3d.XAxis, Vector3d.ZAxis), width, height).ToNurbsCurve();
    Brep outterBrep = Surface.CreateExtrusion(baseCurve, Vector3d.YAxis * depth).ToBrep().CapPlanarHoles(0.01);

    Plane offsetPlane;
    baseCurve.TryGetPlane(out offsetPlane);
    Curve innerCurve = baseCurve.Offset(offsetPlane, -1 * widthOfFrame, 0.01, CurveOffsetCornerStyle.Sharp)[0];

    innerCurve.Transform(Transform.Translation(0, (depth - depthOfGlass) / 2, 0));
    glass = Surface.CreateExtrusion(innerCurve, Vector3d.YAxis * depthOfGlass).ToBrep().CapPlanarHoles(0.01);
    return glass;
  }

  public List<Brep> CreateShutters(Point3d datumPt, double width, double height, double depth, double widthOfFrame, double depthOfGlass, int countOfShutter, int angleOfShutter)
  {
    List<Brep> shutters = new List<Brep>();
    double lengthOfShutter = width - 2 * widthOfFrame;
    double heightOfShutter = (height - 2 * widthOfFrame) / countOfShutter;
    depthOfGlass = Math.Min(depth, depthOfGlass);
    double depthOfShutter = ((depth - depthOfGlass) / 2) / 4;
    double rotateAngle = Rhino.RhinoMath.ToRadians(angleOfShutter);

    Point3d startPoint = new Point3d(datumPt);
    startPoint.Transform(Transform.Translation(widthOfFrame, 0, widthOfFrame));
    
    for (int i = 0; i < countOfShutter; i++)
    {
      Point3d pt = new Point3d(startPoint);
      pt.Transform(Transform.Translation(0, 0, i * heightOfShutter));
      Plane shutterPlane = new Plane(pt, Vector3d.XAxis, Vector3d.ZAxis);
      Curve baseCurve = new Rectangle3d(shutterPlane, lengthOfShutter, heightOfShutter).ToNurbsCurve();
      Brep shutter = Surface.CreateExtrusion(baseCurve, Vector3d.YAxis * depthOfShutter).ToBrep().CapPlanarHoles(0.01);
      shutter.Transform(Transform.Translation(0, depthOfShutter, 0));
      Point3d centerPt = shutter.GetBoundingBox(true).Center;
      shutter.Transform(Transform.Rotation(rotateAngle, Vector3d.XAxis, centerPt));
      shutters.Add(shutter);
    }

    return shutters;
  }
# ---------- end c_script_5 ----------

# ----
merge_2 = Merge(Data1=c_script_5.outWindowFrame, Data2=c_script_5.outGlass, Data3=c_script_5.outShutters)
preview = CustomPreview(Geometry=merge_2, Material=ColourSwatch(SwatchColor=RGB(209, 209, 209)))
